# Grasshopper definition Make2d-ExportAiFile.ghx (Grasshopper 0.9.76)
# plug-ins: Python Interpreter

rectangle = Rectangle(Plane=PlaneXY(0, 0, 0), XSize=Domain(-1, 1), YSize=Domain(-2, 2), Radius=0)  # -> Rectangle, Length
line = Line(Line((10.25868257, -4.972952613, 0), (19.70491499, 11.4578493, 0)))
crv = Curve([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])
boundary = BoundarySurfaces(Edges=rectangle.Rectangle)
pipe = Pipe(Curve=line, Radius=1, Caps=Slider(2, range=0..10))
Z = UnitZ(Factor=1)
extr = Extrude(Base=boundary, Direction=Z)
merge = Merge(Data1=extr, Data2=pipe)
merge_2 = Merge(Data1=crv)
flatten = FlattenTree(Tree=merge, Path="{0}")
flatten_2 = FlattenTree(Tree=merge_2, Path="{0}")
panel = Panel("C:\Users\yoshioca\Documents\AlgorithmicDesign-for-GraphicDesign\Make2d-ExportAi-scripts\")
python = PythonScript(PATH=panel, NAME="Make2d-ExportAiFile", BREP=flatten, CURVE=flatten_2, BOOL=Toggle(False))  # -> out, a; inputs BREP: list of Brep, CURVE: list of Curve, BOOL: Boolean
# ---------- python: Python ----------
import Rhino
import rhinoscriptsyntax as rs
import scriptcontext as sc


out_flie = PATH + NAME + ".ai"



if BOOL == True:
    
    
    sc.doc = Rhino.RhinoDoc.ActiveDoc
    
    
    for i in xrange(len(BREP)):
        sc.doc.Objects.AddBrep(BREP[i])
        
        
    for j in xrange(len(CURVE)):
        sc.doc.Objects.AddCurve(CURVE[j])
    
    
    rs.CurrentView("Perspective")
    
    
    rs.Command(
        'SelAll'
        + ' -Make2d DrawingLayout=CurrentView '
        + ' ShowTangentEdges=Yes '
        + ' CreateHiddenLines=No '
        + ' ShowViewRectangle=No '
        + ' MaintainSourceLayers=Yes _Enter ')
    
    
    rs.CurrentView("Top")
    
    
    rs.Command(
        ' -Export ' + out_flie + ' _Enter'
        + ' SelAll Delete')
    
    
    rs.CurrentView("Perspective")
    
    
    print "Saved!!"
# ---------- end python ----------
panel_2 = Panel(python.out)
